# Dynamo graph TestGraph2.dyn (Dynamo 3.1.0.4534)

integer_slider = IntegerSlider(1, range=0..100 step 1)
flatten = List.Flatten(list=integer_slider)
code_block = CodeBlock { 0; }
getItemAtIndex = List.GetItemAtIndex(list=flatten, index=code_block)
byCoordinates = Point.ByCoordinates(x=getItemAtIndex)
